# Grasshopper definition gHowl_UDP_send+receive.ghx (Grasshopper 0.9.75)
# plug-ins: gHowl

# ---- group: Receive
port = Panel("7001")
udp_owl = UDPReceiver(Port=port, Pattern=0)  # -> Info, Data
panel = Panel(udp_owl.Info)
panel_2 = Panel(udp_owl.Data)

# ---- group: Receive / Parse UDP Message
split = StringSplit(String=udp_owl.Data, Separators=";")
concat = Concatenate(Start="{", End=split)
concat_2 = Concatenate(Start=concat, End=",0}")

# ---- group: Receive / Agents
pt = Point(concat_2)
